# Grasshopper definition 1_Assessing_0117.gh (Grasshopper 1.0.7)
# plug-ins: LunchBox, Moonlight, DeCodingSpaces, Pufferfish, ClipperComponents

# ---- group: 读取开关
boolean_toggle = BooleanToggle(True)

# ----
ghpython_script = GhPythonScript()  # -> out, a, b
# ---------- ghpython_script: Python ----------
file_path1 = r'M:\Matlab_Project\0105_Analysing_Taining_Assessing\C_Assessing\0_calculating\xqyy_5F\0103.xlsx'

a=file_path1
# ---------- end ghpython_script ----------
panel = Panel(ghpython_script.a)
excel_reader = ExcelReader(ReadExcelData=boolean_toggle, WorkbookPath=panel, WorksheetName="Sheet1")  # -> Exceptions, ExcelData
explode_tree = ExplodeTree(Data=excel_reader.ExcelData)  # -> Branch0, Branch1, Branch2, Branch3, Branch4, Branch5, Branch6, Branch7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
panel_2 = Panel(excel_reader.ExcelData)
list_length = ListLength(List=explode_tree.Branch7)
panel_3 = Panel(list_length)
number_slider = Slider(1, range=1..30)
list_item = ListItem(List=explode_tree.Branch6, Index=number_slider, Wrap=True)
list_item_2 = ListItem(List=explode_tree.Branch7, Index=number_slider, Wrap=True)
ghpython_script_2 = GhPythonScript(x=list_item_2)  # -> out, flatten(a)
# ---------- ghpython_script_2: Python ----------
import rhinoscriptsyntax as rs
import Rhino.Geometry as rg
import ast

# 原始数据作为列表
data_str = x  # 这里假设 x 已经是一个列表，如你所提供

# 创建点列表
data_list = ast.literal_eval(data_str)

points = []



for i in data_list:
    points.append(rs.AddPoint(i[0],i[1],0))

a = points
# ---------- end ghpython_script_2 ----------
路径节点坐标 = Panel(ghpython_script_2.a)
编号 = Panel(list_item)

# ---- group: 写入开关
boolean_toggle_2 = BooleanToggle(False)

# ----
编号_2 = Panel("0207")

# ---- group: 内部不可视区域
_4f内部不可视区域 = Curve([<curve referenced from the Rhino model> x16])
_3f内部不可视区域 = Curve([<curve referenced from the Rhino model> x15])
_2f内部不可视区域 = Curve([<curve referenced from the Rhino model> x9])

大坪1f内部不可视 = Curve(<curve referenced from the Rhino model>)
重一3f内部不可视 = Curve([<curve referenced from the Rhino model> x3])
新桥5f内部不可视 = Curve(<curve referenced from the Rhino model>)
重二7f内部不可视 = Curve([<curve referenced from the Rhino model> x8])

# ---- group: 路网系统
_3f路网系统 = Curve([<curve referenced from the Rhino model> x63])
_2f路网系统 = Curve([<curve referenced from the Rhino model> x70])
_4f路网系统 = Curve([<curve referenced from the Rhino model> x71])

重一3f路网 = Curve([<curve referenced from the Rhino model> x63])
新桥5f路网 = Curve([<curve referenced from the Rhino model> x27])
大坪1f系统 = Curve([<curve referenced from the Rhino model> x22])
重二7f路网 = Curve([<curve referenced from the Rhino model> x38])

# ---- group: 可见范围
_4f可见范围 = Curve([<curve referenced from the Rhino model> x17])
_3f可见范围 = Curve([<curve referenced from the Rhino model> x16])
_2f可见范围 = Curve([<curve referenced from the Rhino model> x10])

# ----
moonlight = Moonlight(Mode=True)

# ---- group: 可见范围
重一3f可见 = Curve([<curve referenced from the Rhino model> x4])
新桥5f可见 = Curve([<curve referenced from the Rhino model> x2])
大坪1f可见 = Curve([<curve referenced from the Rhino model> x2])
重二7f可见 = Curve([<curve referenced from the Rhino model> x9])

# ---- group: 路径节点拾取
point = Point()

# ----
polyline = PolyLine(Vertices=point, Closed=False)

# ---- group: 路网系统（原始）
curve = Curve(大坪1f系统)

# ---- group: 内部不可视范围
curve_2 = Curve(大坪1f内部不可视)

# ---- group: 可见范围
curve_3 = Curve(大坪1f可见)

# ----
ghpython_script_3 = GhPythonScript(x=编号_2)  # -> out, a, b
# ---------- ghpython_script_3: Python ----------
file_path1 = 'M:\\Matlab_Project\\0105_Analysing_Taining_Assessing\\C_Assessing\\0_calculating\\xnyy_3F_Final\\'+str(x)+'.xlsx'

a = file_path1
# ---------- end ghpython_script_3 ----------
cluster = Cluster(C=curve)
join_curves = JoinCurves(Curves=polyline, Preserve=False)
curve_4 = Curve()

# ---- group: 路网系统（打断）
curve_5 = Curve(cluster)

# ----
panel_4 = Panel(ghpython_script_3.a)
explode = Explode(Curve=curve_4, Recursive=True)  # -> Segments, flatten(Vertices)
curve_6 = Curve(curve_4)

# ---- group: 路径
curve_7 = Curve(curve_4)

# ----
deconstruct = Deconstruct(Point=explode.Vertices)  # -> XComponent, YComponent, ZComponent

# ---- group: 路径显示
curve_8 = Curve(reparameterize(curve_6))
pipe = Pipe(Curve=curve_8, Radius=Slider(0.2, range=0..1), Caps=2)
custom_preview = CustomPreview(Geometry=pipe, Material=ColourSwatch(SwatchColor=RGB(0, 0, 0)))

# ----
ghpython_script_4 = GhPythonScript(x=deconstruct.XComponent, y=deconstruct.YComponent)  # -> out, a, b; inputs x: list, y: list, z: list, u: list
# ---------- ghpython_script_4: Python ----------
nodesx = x
nodesy = y
stopsx = z
stopsy = u

nodes = []
stops = []

for i in range(len(nodesx)):
    node = (nodesx[i],nodesy[i])
    nodes.append(node)

for i in range(len(stopsx)):
    stop = (stopsx[i],stopsy[i])
    stops.append(stop)

print(nodes)
print(stops)

a = str(nodes)
b = str(stops)
# ---------- end ghpython_script_4 ----------
路径节点坐标_2 = Panel(ghpython_script_4.a)
entwine = Entwine(Branch00=编号_2, Branch01=ghpython_script_4.a, FlattenInputs=True)
number_slider_2 = Slider(0.8, range=0..10)  # disabled
end_points = EndPoints(Curve=curve_7)  # -> Start, End

# ---- group: 完整路径
curve_9 = Curve(curve_7)

# ---- group: 路径终点
point_2 = Point(end_points.End)

# ---- group: 可视域网格划分 / 路径起点
curve_10 = Curve(curve_7)
end_points_2 = EndPoints(Curve=curve_10)  # -> Start, End
point_3 = Point(end_points_2.Start)

# ---- group: 路网系统
curve_11 = Curve(flatten(curve_5))

# ---- group: 完整路径
curve_12 = Curve(curve_7)

# ----
curve_curve = CurveCurve(CurveA=curve_11, CurveB=curve_12)  # -> flatten(Points), ParamsA, ParamsB
create_set = CreateSet(List=curve_curve.Points)  # -> Set, Map
ghpython_script_5 = GhPythonScript(x=create_set.Set)  # -> out, a; inputs x: list
# ---------- ghpython_script_5: Python ----------
import rhinoscriptsyntax as rs

def remove_duplicates(guids, tolerance=0.01):
    # 将 Guid 转换为 Point3d
    points = [rs.coerce3dpoint(guid) for guid in guids]

    # 创建一个空集合用于存储唯一的点
    unique_points_set = set()

    for point in points:
        # 判断当前点是否与集合中的点相似（在容差范围内）
        is_unique = True
        for unique_point in unique_points_set:
            if rs.Distance(point, unique_point) < tolerance:
                is_unique = False
                break

        if is_unique:
            unique_points_set.add(point)

    return list(unique_points_set)

# 从 x 端口接收的 Guid 列表
guids = x

# 调用函数移除重复点
unique_points = remove_duplicates(guids)

# 将结果输出到 a 端口
a = unique_points
# ---------- end ghpython_script_5 ----------

# ---- group: 可见性分析
number_slider_3 = Slider(50, range=0..100)  # disabled
curve_13 = Curve()  # disabled
point_4 = Point()  # disabled
explode_2 = Explode(Curve=curve_13, Recursive=True)  # -> flatten(Segments), Vertices; disabled
end_points_3 = EndPoints(Curve=explode_2.Segments)  # -> Start, End; disabled
number_slider_4 = Slider(1.1, range=0..1.4)  # disabled
line = Line(StartPoint=end_points_3.Start, EndPoint=end_points_3.End)  # disabled
boundary_surfaces = BoundarySurfaces(Edges=curve_13)  # disabled
analysis_grid = AnalysisGrid(ObstacleLines=line, CellSize=number_slider_4, FillPoint=point_4)  # -> AnalysisPoints, GridCells; disabled
point_5 = Point(flatten(analysis_grid.AnalysisPoints))  # disabled
rectangle = Rectangle(flatten(analysis_grid.GridCells))  # disabled
ghpython_script_6 = GhPythonScript(x=point_5, y=boundary_surfaces, z=rectangle)  # -> out, a, b; inputs x: list, z: list; disabled
# ---------- ghpython_script_6: Python ----------
import rhinoscriptsyntax as rs
points = x
surface = y
rec = z

retained_points = []
retained_rec = []

for index, i in enumerate(points):
    test = rs.IsPointOnSurface(surface,i)
    if test:
        retained_points.append(points[index])
        retained_rec.append(rec[index])
        continue

a = retained_points
b = retained_rec
# ---------- end ghpython_script_6 ----------
point_6 = Point(flatten(ghpython_script_6.a))  # disabled
rectangle_2 = Rectangle(flatten(ghpython_script_6.b))  # disabled
ghpython_script_7 = GhPythonScript(x=point_6, y=line, z=number_slider_3)  # -> out, a, flatten(b), flatten(c), flatten(d); inputs x: list, y: list; disabled
# ---------- ghpython_script_7: Python ----------
import Rhino.Geometry as rg
import scriptcontext as sc
import rhinoscriptsyntax as rs

def create_grid(obstacles, grid_size):
    grid = {}
    for obstacle in obstacles:
        bbox = obstacle.GetBoundingBox(True)
        min_key = (int(bbox.Min.X // grid_size), int(bbox.Min.Y // grid_size), int(bbox.Min.Z // grid_size))
        max_key = (int(bbox.Max.X // grid_size), int(bbox.Max.Y // grid_size), int(bbox.Max.Z // grid_size))

        for x in range(min_key[0], max_key[0] + 1):
            for y in range(min_key[1], max_key[1] + 1):
                for z in range(min_key[2], max_key[2] + 1):
                    grid_key = (x, y, z)
                    if grid_key not in grid:
                        grid[grid_key] = set()
                    grid[grid_key].add(obstacle)
    return grid

def is_visible(pt1, pt2, grid, grid_size, obstacles, visibility_threshold):
    # 初步距离检查
    if pt1.DistanceTo(pt2) > visibility_threshold:
        return False

    line = rg.LineCurve(pt1, pt2)
    line_bbox = line.GetBoundingBox(True)
    checked_obstacles = set()

    min_key = (int(line_bbox.Min.X // grid_size), int(line_bbox.Min.Y // grid_size), int(line_bbox.Min.Z // grid_size))
    max_key = (int(line_bbox.Max.X // grid_size), int(line_bbox.Max.Y // grid_size), int(line_bbox.Max.Z // grid_size))

    for x in range(min_key[0], max_key[0] + 1):
        for y in range(min_key[1], max_key[1] + 1):
            for z in range(min_key[2], max_key[2] + 1):
                grid_key = (x, y, z)
                if grid_key in grid:
                    for obstacle_curve in grid[grid_key]:
                        if obstacle_curve not in checked_obstacles:
                            checked_obstacles.add(obstacle_curve)
                            if line_curve_intersection(line, obstacle_curve):
                                return False
    return True

def line_curve_intersection(line, curve):
    intersection = rg.Intersect.Intersection.CurveCurve(line, curve, 0.001, 0.001)
    return intersection.Count > 0

def create_adjacency_matrix(points, obstacles, grid_size, visibility_threshold):
    n = len(points)
    adjacency_matrix = [[0 for j in range(n)] for i in range(n)]
    grid = create_grid(obstacles, grid_size)

    for i in range(n):
        for j in range(i + 1, n):
            if is_visible(points[i], points[j], grid, grid_size, obstacles, visibility_threshold):
                adjacency_matrix[i][j] = 1
                adjacency_matrix[j][i] = 1

    return adjacency_matrix

def count_ones_in_matrix(matrix):
    count = 0
    for row in matrix:
        count += sum(row)
    return count

def calculate_visual_depth(adj_matrix, start_index, dest_index):
    if start_index == dest_index:
        return 0

    depth = 0
    visited = set([start_index])
    current_level = {start_index}

    while current_level:
        depth += 1
        next_level = set()
        for node in current_level:
            for i, connected in enumerate(adj_matrix[node]):
                if connected and i not in visited:
                    if i == dest_index:
                        return depth
                    next_level.add(i)
        visited.update(current_level)  # 更新已访问的节点
        current_level = next_level  # 移动到下一层级

    return -1  # 如果没有找到路径，则返回 -1

def calculate_revelation_coefficient(adj_matrix, point_index):
    # 直接邻域
    direct_neighbors = {i for i, connected in enumerate(adj_matrix[point_index]) if connected}
    
    # 下一级邻域（通过直接邻居的邻居，但不是直接邻居的点）
    next_level_neighbors = set()
    for neighbor in direct_neighbors:
        next_level_neighbors.update({i for i, connected in enumerate(adj_matrix[neighbor]) if connected})

    # 排除直接邻域和当前点
    next_level_neighbors -= direct_neighbors
    next_level_neighbors.discard(point_index)

    # 计算揭示系数：下一级邻域点数 / 直接邻域点数
    if len(direct_neighbors) == 0:
        return 0  # 避免除以零
    return len(next_level_neighbors) / len(direct_neighbors)


    return len(next_level_neighbors) / len(direct_neighbors)

def calculate_average_revelation_coefficient(adj_matrix, decision_points):
    total_revelation_coefficient = sum(calculate_revelation_coefficient(adj_matrix, point) for point in decision_points)
    return total_revelation_coefficient / len(decision_points)

def calculate_visibility(adjacency_matrix):
    visibility_list = []
    for row in adjacency_matrix:
        visibility = sum(row)  # 计算每行中1的数量
        visibility_list.append(visibility)
    return visibility_list


# 将 Guid 转换为 Point3d
points = [sc.doc.Objects.Find(guid).Geometry.Location for guid in x]

# 假设obstacles已经是线段列表
obstacle_curves = [sc.doc.Objects.Find(guid).Geometry for guid in y if isinstance(sc.doc.Objects.Find(guid).Geometry, rg.LineCurve)]

# 从z端输入距离阈值
visibility_threshold = z

# 创建邻接矩阵
adj_matrix = create_adjacency_matrix(points, obstacle_curves, 10, visibility_threshold)

# 计算每个点的可见性
visibility_list = calculate_visibility(adj_matrix)

a = visibility_list
# ---------- end ghpython_script_7 ----------
bounds = Bounds(Numbers=ghpython_script_7.a)  # disabled
surface = Surface(rectangle_2)  # disabled
deconstruct_domain = DeconstructDomain(Domain=bounds)  # -> Start, End; disabled
gradient = Gradient(
    LowerLimit=deconstruct_domain.End,
    UpperLimit=deconstruct_domain.Start,
    Parameter=ghpython_script_7.a,
    stops=[0: RGB(234, 38, 0), 0.25: RGB(234, 126, 0), 0.5: RGB(254, 244, 84), 0.75: RGB(173, 203, 249), 1: RGB(75, 107, 169)])  # disabled
custom_preview_2 = CustomPreview(Geometry=surface, Material=gradient)  # disabled

# ---- group: 道路交叉口
point_7 = Point(flatten(ghpython_script_5.a))

# ----
curve_14 = Curve(curve_9)
end_points_4 = EndPoints(Curve=curve_14)  # -> Start, End
line_2 = Line(StartPoint=end_points_4.Start, EndPoint=end_points_4.End)
length = Length(Curve=curve_9)  # -> flatten(Length)
length_2 = Length(Curve=line_2)
division = Division(A=length, B=length_2)  # -> flatten(Result)
绕行率 = Panel(division)

list_length_2 = ListLength(List=point_7)  # -> flatten(Length)
决策点数量 = Panel(list_length_2)

认知年龄 = Panel("30")
panel_5 = Panel("""认知年龄
路径视域聚合系数
步点视域圆度标准差
决策点数量
平均决策点质心吸引度
绕行率
编号
路径节点坐标""")
explode_tree_2 = ExplodeTree(Data=entwine)  # -> flatten(Branch0), flatten(Branch1)

divide_distance = DivideDistance(Curve=curve_7, Distance=Slider(0.7, range=0..10))  # -> Points, Tangents, Parameters

# ---- group: 步点
point_8 = Point(flatten(divide_distance.Points))

# ----
point_list = PointList(Points=point_8, Size=Slider(1, range=0..100))

# ---- group: 步点视域计算
number_slider_5 = Slider(50, range=0..100)
number_slider_6 = Slider(360, range=0..1000)
isovist = IsoVist(Plane=point_8, Count=number_slider_6, Radius=number_slider_5, Obstacles=curve_3)  # -> Points, Distance, Index
polyline_2 = PolyLine(Vertices=isovist.Points, Closed=True)
boundary_surfaces_2 = BoundarySurfaces(Edges=polyline_2)  # -> flatten(Surfaces)

# ----
panel_6 = Panel(point_8)

# ---- group: 各步点视域
surface_2 = Surface(boundary_surfaces_2)

# ---- group: 路径可视域合并生成 / 合并步点可视域轮廓
surface_3 = Surface(surface_2)
project = Project(Geometry=surface_3, Plane=PlaneXY(0, 0, 0))  # -> Geometry, Transform
curve_15 = Curve(flatten(project.Geometry))
ghpython_script_8 = GhPythonScript(x=curve_15)  # -> out, a; inputs x: list
# ---------- ghpython_script_8: Python ----------
import rhinoscriptsyntax as rs

def try_merge_curves(curves, tolerance=0.0001):
    if not curves:
        return None

    merged_curve = curves[0]
    for curve in curves[1:]:
        result = rs.CurveBooleanUnion([merged_curve, curve], tolerance)
        if result:
            # 如果成功合并，更新merged_curve
            if len(result) > 1:
                print("Multiple curves resulted from a boolean operation, taking the first one.")
                merged_curve = result[0]
            else:
                merged_curve = result[0]
        else:
            # 返回当前合并结果和剩余未合并的曲线
            return merged_curve, curves[curves.index(curve):]
    
    return merged_curve, None

def robust_curve_boolean_union(curves, tolerance=0.0001):
    waiting_list = []
    remaining_curves = curves

    while remaining_curves:
        result, remaining_curves = try_merge_curves(remaining_curves, tolerance)
        if result:
            waiting_list.append(result)
        if not remaining_curves:
            break

    if len(waiting_list) == 1:
        return waiting_list[0]
    else:
        return try_merge_curves(waiting_list, tolerance)[0]


curves = x 

merged_curve = robust_curve_boolean_union(curves)

a = merged_curve
# ---------- end ghpython_script_8 ----------

# ---- group: 步点视域移动显示
number_slider_7 = Slider(37, range=0..128)  # disabled
list_item_3 = ListItem(List=surface_2, Index=number_slider_7, Wrap=True)  # disabled
list_item_4 = ListItem(List=point_8, Index=number_slider_7, Wrap=True)  # disabled
sphere = Sphere(Base=list_item_4, Radius=number_slider_2)  # disabled

# ---- group: 步点
point_9 = Point(flatten(point_8))

# ---- group: 交叉口步点编号
ghpython_script_9 = GhPythonScript(x=point_9, y=point_7)  # -> out, a; inputs x: list, y: list
# ---------- ghpython_script_9: Python ----------
import rhinoscriptsyntax as rs

steps = x
intersecs = y
indeces = []

#找到步点中最接近交叉口的步点编号
for i in intersecs:
    index = None
    min_distance = None
    for number,j in enumerate(steps):
        distance = rs.Distance(i,j)
        if min_distance is None or distance < min_distance:
            min_distance = distance
            index = number
    indeces.append(index)

a = indeces
# ---------- end ghpython_script_9 ----------
sort_list = SortList(Keys=ghpython_script_9.a)  # -> Keys, ValuesValuesA

# ---- group: 各步点视域
surface_4 = Surface(surface_2)

# ----
list_item_5 = ListItem(List=surface_4, Index=sort_list.Keys, Wrap=True)
list_item_6 = ListItem(List=point_9, Index=sort_list.Keys, Wrap=True)
list_length_3 = ListLength(List=list_item_5)  # -> expr("x-1", Length)
list_length_4 = ListLength(List=list_item_6)  # -> expr("x-1", Length)
partition_list = PartitionList(List=list_item_5, Size=list_length_3)
explode_tree_3 = ExplodeTree(Data=partition_list)  # -> Branch0, Branch1
partition_list_2 = PartitionList(List=list_item_6, Size=list_length_4)
explode_tree_4 = ExplodeTree(Data=partition_list_2)  # -> Branch0, Branch1

# ---- group: 交叉口步点视域
surface_5 = Surface(flatten(explode_tree_3.Branch0))

# ---- group: 交叉口步点
point_10 = Point(explode_tree_4.Branch0)

# ---- group: 排除最后一点重合的情况
ghpython_script_10 = GhPythonScript(x=point_10, y=point_2)  # -> out, a; inputs x: list
# ---------- ghpython_script_10: Python ----------
import rhinoscriptsyntax as rs
points = []
desti = y
for i in x:
    if i != desti:
        points.append(i)
    else:
        continue

a = points
# ---------- end ghpython_script_10 ----------

# ----
area = Area(Geometry=surface_5)  # -> Area, Centroid
line_3 = Line(StartPoint=ghpython_script_10.a, EndPoint=point_2)
line_4 = Line(StartPoint=point_10, EndPoint=area.Centroid)
length_3 = Length(Curve=line_4)
angle = Angle(VectorA=line_3, VectorB=line_4)  # -> Angle, Reflex
pi = Pi(Factor=1)
list_length_5 = ListLength(List=point_10)
division_2 = Division(A=pi, B=Slider(2, range=0..10))
subtraction = Subtraction(A=angle.Angle, B=division_2)
multiplication = Multiplication(A=subtraction, B="-1")
division_3 = Division(A=multiplication, B=division_2)
multiplication_2 = Multiplication(A=division_3, B=length_3)
mass_addition = MassAddition(Input=multiplication_2)  # -> Result, PartialResults
division_4 = Division(A=mass_addition.Result, B=list_length_5)  # -> flatten(Result)
视域质心吸引度 = Panel(division_4)

sphere_2 = Sphere(Base=area.Centroid, Radius=Slider(0.5, range=0..1))
custom_preview_3 = CustomPreview(Geometry=sphere_2, Material=ColourSwatch(SwatchColor=RGB(255, 255, 255)))

mass_addition_2 = MassAddition(Input=isovist.Distance)  # -> Result, PartialResults
division_5 = Division(A=mass_addition_2.Result, B=number_slider_6)  # -> flatten(Result)
area_2 = Area(Geometry=surface_2)  # -> Area, Centroid
square = Square(Value=division_5)
pi_2 = Pi(Factor=square)
division_6 = Division(A=pi_2, B=area_2.Area)
圆度 = Panel(division_6)

# ---- group: 步点视域圆度标准差
ghpython_script_11 = GhPythonScript(x=division_6)  # -> out, mean, variance, std_deviation; inputs x: list
# ---------- ghpython_script_11: Python ----------
import statistics

data = x

#计算平均数
mean = statistics.mean(data)

# 计算方差
variance = statistics.variance(data)

# 计算标准差
std_deviation = statistics.stdev(data)

# 返回方差和标准差
# ---------- end ghpython_script_11 ----------
步点视域圆度标准差 = Panel(ghpython_script_11.std_deviation)

# ---- group: 路径可视域合并生成
number_slider_8 = Slider(1, range=0..1)

# ---- group: 路径可视域合并生成 / 将轮廓直线段化
fit_curve_smooth = FitCurveSmooth(Curve=ghpython_script_8.a, Degree=number_slider_8, DeviationTolerance=0.001, AngleTolerance=1)
curve_16 = Curve(fit_curve_smooth)
explode_3 = Explode(Curve=curve_16, Recursive=True)  # -> flatten(Segments), Vertices
end_points_5 = EndPoints(Curve=explode_3.Segments)  # -> Start, End
line_5 = Line(StartPoint=end_points_5.Start, EndPoint=end_points_5.End)

# ---- group: 路径可视域合并生成 (continued)
join_curves_2 = JoinCurves(Curves=line_5, Preserve=False)  # -> flatten(Curves)
polyline_boolean = PolylineBoolean(
    A=join_curves_2,
    B=curve_2,
    BooleanType=2,
    Plane=Plane(origin=(0, 0, 0), x=(0, 0, 0), y=(0, 0, 0)),
    Tolerance=0.001,
    EvenOdd=True)
explode_4 = Explode(Curve=polyline_boolean, Recursive=True)  # -> flatten(Segments), Vertices
end_points_6 = EndPoints(Curve=explode_4.Segments)  # -> Start, End
boundary_surfaces_3 = BoundarySurfaces(Edges=polyline_boolean)
line_6 = Line(StartPoint=end_points_6.Start, EndPoint=end_points_6.End)

# ---- group: 路径可视域曲面
surface_6 = Surface(flatten(boundary_surfaces_3))

# ---- group: 路径可视域轮廓
curve_17 = Curve(flatten(polyline_boolean))

# ---- group: 可视域直线段轮廓
line_7 = Line(line_6)

# ----
custom_preview_4 = CustomPreview(Geometry=surface_6, Material=ColourSwatch(SwatchColor=RGB(202, 188, 209)))

# ---- group: 可视域网格划分
analysis_grid_2 = AnalysisGrid(ObstacleLines=line_7, CellSize=Slider(1.1, range=0..1.4), FillPoint=point_3)  # -> AnalysisPoints, GridCells
point_11 = Point(flatten(analysis_grid_2.AnalysisPoints))
rectangle_3 = Rectangle(flatten(analysis_grid_2.GridCells))

# ---- group: 可视域网格划分 / 将不在视域中的格点剔除
ghpython_script_12 = GhPythonScript(x=point_11, y=surface_6, z=rectangle_3)  # -> out, a, b; inputs x: list, z: list; same code as ghpython_script_6

# ---- group: 可视域网格
rectangle_4 = Rectangle(flatten(ghpython_script_12.b))

# ---- group: 可视域格点
point_12 = Point(flatten(ghpython_script_12.a))

# ---- group: 视域内格点
point_13 = Point(point_12)

# ----
end_points_7 = EndPoints(Curve=curve_7)  # -> Start, End
closest_point = ClosestPoint(Point=point_7, Cloud=point_13)  # -> ClosestPoint, CPIndex, Distance

# ---- group: 路径起点
point_14 = Point(end_points_7.Start)

# ---- group: 路径终点
point_15 = Point(end_points_7.End)

# ----
closest_point_2 = ClosestPoint(Point=point_15, Cloud=point_13)  # -> ClosestPoint, CPIndex, Distance
closest_point_3 = ClosestPoint(Point=point_14, Cloud=point_13)  # -> ClosestPoint, CPIndex, Distance
ghpython_script_13 = GhPythonScript(x=point_13, y=line_7, z=number_slider_5, u=closest_point_3.CPIndex, v=closest_point_2.CPIndex, w=closest_point.CPIndex)  # -> out, a, flatten(b), flatten(c), flatten(d); inputs x: list, y: list, w: list
# ---------- ghpython_script_13: Python ----------
import Rhino.Geometry as rg
import scriptcontext as sc
import rhinoscriptsyntax as rs

def create_grid(obstacles, grid_size):
    grid = {}
    for obstacle in obstacles:
        bbox = obstacle.GetBoundingBox(True)
        min_key = (int(bbox.Min.X // grid_size), int(bbox.Min.Y // grid_size), int(bbox.Min.Z // grid_size))
        max_key = (int(bbox.Max.X // grid_size), int(bbox.Max.Y // grid_size), int(bbox.Max.Z // grid_size))

        for x in range(min_key[0], max_key[0] + 1):
            for y in range(min_key[1], max_key[1] + 1):
                for z in range(min_key[2], max_key[2] + 1):
                    grid_key = (x, y, z)
                    if grid_key not in grid:
                        grid[grid_key] = set()
                    grid[grid_key].add(obstacle)
    return grid

def is_visible(pt1, pt2, grid, grid_size, obstacles, visibility_threshold):
    # 初步距离检查
    if pt1.DistanceTo(pt2) > visibility_threshold:
        return False

    line = rg.LineCurve(pt1, pt2)
    line_bbox = line.GetBoundingBox(True)
    checked_obstacles = set()

    min_key = (int(line_bbox.Min.X // grid_size), int(line_bbox.Min.Y // grid_size), int(line_bbox.Min.Z // grid_size))
    max_key = (int(line_bbox.Max.X // grid_size), int(line_bbox.Max.Y // grid_size), int(line_bbox.Max.Z // grid_size))

    for x in range(min_key[0], max_key[0] + 1):
        for y in range(min_key[1], max_key[1] + 1):
            for z in range(min_key[2], max_key[2] + 1):
                grid_key = (x, y, z)
                if grid_key in grid:
                    for obstacle_curve in grid[grid_key]:
                        if obstacle_curve not in checked_obstacles:
                            checked_obstacles.add(obstacle_curve)
                            if line_curve_intersection(line, obstacle_curve):
                                return False
    return True

def line_curve_intersection(line, curve):
    intersection = rg.Intersect.Intersection.CurveCurve(line, curve, 0.001, 0.001)
    return intersection.Count > 0

def create_adjacency_matrix(points, obstacles, grid_size, visibility_threshold):
    n = len(points)
    adjacency_matrix = [[0 for j in range(n)] for i in range(n)]
    grid = create_grid(obstacles, grid_size)

    for i in range(n):
        for j in range(i + 1, n):
            if is_visible(points[i], points[j], grid, grid_size, obstacles, visibility_threshold):
                adjacency_matrix[i][j] = 1
                adjacency_matrix[j][i] = 1

    return adjacency_matrix

def count_ones_in_matrix(matrix):
    count = 0
    for row in matrix:
        count += sum(row)
    return count

def calculate_visual_depth(adj_matrix, start_index, dest_index):
    if start_index == dest_index:
        return 0

    depth = 0
    visited = set([start_index])
    current_level = {start_index}

    while current_level:
        depth += 1
        next_level = set()
        for node in current_level:
            for i, connected in enumerate(adj_matrix[node]):
                if connected and i not in visited:
                    if i == dest_index:
                        return depth
                    next_level.add(i)
        visited.update(current_level)  # 更新已访问的节点
        current_level = next_level  # 移动到下一层级

    return -1  # 如果没有找到路径，则返回 -1

def calculate_revelation_coefficient(adj_matrix, point_index):
    # 直接邻域
    direct_neighbors = {i for i, connected in enumerate(adj_matrix[point_index]) if connected}
    
    # 下一级邻域（通过直接邻居的邻居，但不是直接邻居的点）
    next_level_neighbors = set()
    for neighbor in direct_neighbors:
        next_level_neighbors.update({i for i, connected in enumerate(adj_matrix[neighbor]) if connected})

    # 排除直接邻域和当前点
    next_level_neighbors -= direct_neighbors
    next_level_neighbors.discard(point_index)

    # 计算揭示系数：下一级邻域点数 / 直接邻域点数
    if len(direct_neighbors) == 0:
        return 0  # 避免除以零
    return len(next_level_neighbors) / len(direct_neighbors)


    return len(next_level_neighbors) / len(direct_neighbors)

def calculate_average_revelation_coefficient(adj_matrix, decision_points):
    total_revelation_coefficient = sum(calculate_revelation_coefficient(adj_matrix, point) for point in decision_points)
    return total_revelation_coefficient / len(decision_points)



# 将 Guid 转换为 Point3d
points = [sc.doc.Objects.Find(guid).Geometry.Location for guid in x]

# 假设obstacles已经是线段列表
obstacle_curves = [sc.doc.Objects.Find(guid).Geometry for guid in y if isinstance(sc.doc.Objects.Find(guid).Geometry, rg.LineCurve)]

# 从z端输入距离阈值
visibility_threshold = z

# 创建邻接矩阵
adj_matrix = create_adjacency_matrix(points, obstacle_curves, 10, visibility_threshold)

# 统计邻接矩阵中1的数量
number_of_ones = count_ones_in_matrix(adj_matrix)

# 计算聚合系数
E_number = number_of_ones
k = len(points)
Y = E_number / (k * (k - 1))

# 获取起点和终点索引
#startPP_index = u  # 起点索引
#destiPP_index = v  # 终点索引

# 计算视觉深度
#visual_depth = calculate_visual_depth(adj_matrix, startPP_index, destiPP_index)

# 从 w 端输入的决策点索引列表
#decision_points = w

# 计算揭示系数平均值
#average_revelation_coefficient = calculate_average_revelation_coefficient(adj_matrix, decision_points)


# 输出结果
a = adj_matrix  # 邻接矩阵
b = Y           # 聚合系数
#c = visual_depth  # 视觉深度
#d = average_revelation_coefficient  # 揭示系数平均值
# ---------- end ghpython_script_13 ----------
聚合系数 = Panel(ghpython_script_13.b)

entwine_2 = Entwine(
    Branch00=认知年龄,
    Branch01=聚合系数,
    Branch02=步点视域圆度标准差,
    Branch03=决策点数量,
    Branch04=视域质心吸引度,
    Branch05=绕行率,
    Branch06=explode_tree_2.Branch0,
    Branch07=explode_tree_2.Branch1,
    FlattenInputs=True)
panel_7 = Panel(entwine_2)
excel_write = ExcelWrite(
    WriteExcelData=boolean_toggle_2,
    WorkbookPath=panel_4,
    WorksheetName="Sheet1",
    ColumnHeadings=panel_5,
    Data=panel_7,
    ClearSheet=False)
输出状况面板 = Panel(excel_write)

# ==== cluster Cluster
C = ClusterInput()
explode = Explode(Curve=C, Recursive=True)  # -> flatten(Segments), Vertices
mcx = MultipleCurves(Curves=explode.Segments)  # -> Points, IndexA, IndexB, ParamA, ParamB
sunion = SetUnion(SetA=mcx.IndexA, SetB=mcx.IndexB)  # -> graft(Union)
item = ListItem(List=explode.Segments, Index=sunion, Wrap=True)
equals = Equality(FirstNumber=mcx.IndexA, SecondNumber=sunion)  # -> Equality, Inequality
equals_2 = Equality(FirstNumber=mcx.IndexB, SecondNumber=sunion)  # -> Equality, Inequality
cull = CullPattern(List=mcx.ParamA, CullPattern=equals.Equality)
cull_2 = CullPattern(List=mcx.ParamB, CullPattern=equals_2.Equality)
merge = Merge(Data1=cull, Data2=cull_2)
shatter = Shatter(Curve=item, Parameters=merge)  # -> simplify(flatten(Segments))
S = ClusterOutput(shatter)
